# Dynamo graph Building Generator.dyn (Dynamo 2.0.2.6826)

string = StringInput("O")
XY = Plane.XY()
length = DoubleSlider(20, range=0..100 step 1)
width = DoubleSlider(20, range=0..100 step 1)
depth = DoubleSlider(1, range=0..100 step 1)
total_floor_area = DoubleSlider(339, range=0..10000 step 1)
floor_height = DoubleSlider(20, range=0..100 step 1)
boolean = BoolSelector(false)
buildingGenerator = Buildings.Creation.BuildingGenerator(Type=string, BasePlane=XY, Length=length, Width=width, Depth=depth, BldgArea=total_floor_area, FloorHeight=floor_height, CreateCore=boolean)
